# Grasshopper definition follow_path.gh (Grasshopper 1.0.7)
# plug-ins: Robots

list = RobotsLibrary(
    {"UR5e", "CITA-IRB1600-145 + Turntable", "CITA-IRB1600-145 + IRB140", "CITA-IRB1600-145", "CITA-IRB140", "CITA-UR5e"}, selected="UR5e",
    Type=0)
focal_point = Point(<point referenced from the Rhino model>)
camera_path = Curve(<curve referenced from the Rhino model>)
divide = DivideCurve(Curve=camera_path, Count=10, Kinks=False)  # -> Points, Tangents, Parameters
panel = Panel("popup(\"Waiting to Continue\", title=\"Ready?\", blocking=True)")
loadrobot = LoadRobotSystem(Name=list, Base=PlaneXY(0, 0, 0))
vec2pt = Vector2Pt(PointA=divide.Points, PointB=focal_point, Unitize=True)  # -> Vector, Length
list_2 = FlagFields({"Shoulder": 1, "Elbow": 2, "Wrist": 4}, selected="Shoulder")
pl = PlaneNormal(Origin=divide.Points, ZAxis=vec2pt.Vector)
customcmd = CustomCommand(Name="CustomCommand", Manufacturer="UR", Code=panel)
list_3 = ValueList({"Joint", "Linear"}, selected="Linear")
pflip = FlipPlane(Plane=pl, ReverseX=False, ReverseY=Toggle(True), SwapAxes=True)
pln = Plane(pflip)
target = CreateTarget(Plane=pln, RobConf=list_2, Motion=list_3, Command=customcmd, IsCartesian=True)
robotsystem = RobotSystemParameter(loadrobot)
command = CommandParameter(customcmd)
targets = TargetParameter(target)
program = CreateProgram(Name="DefaultProgram", RobotSystem=robotsystem, Targets=targets, InitCommands=command, StepSize=1)  # -> Program, Code, Duration, Warnings, Errors
program_2 = Panel(program.Code)
warnings = Panel(program.Warnings)
errors = Panel(program.Errors)
program_3 = ProgramParameter(program.Program)
sim = ProgramSimulation(Program=program_3, Time=Slider(1, range=0..1), Normalized=True)  # -> SystemMeshes, JointRotations, Plane, Index, Time, Program, Errors
remote = RemoteConnection(Program=program_3, IP="127.0.0.1", Upload=Button(), Play=False, Pause=False)
