# Grasshopper definition follow_path_target_advanced.gh (Grasshopper 1.0.7)
# plug-ins: Robots

# ---- group: Robot System
list = RobotsLibrary({"UR3e", "UR5e", "UR10e", "UR16e", "UR3", "UR5", "UR10"}, selected="UR10e", Type=0)
loadrobot = LoadRobotSystem(Name=list, Base=PlaneXY(0, 0, 0))

# ---- group: Make Initial Pop Up for Remote Safety
initial_pop_up_command = Panel("popup(\"Press 'Continue' to reset to Pose 0.\", title=\"Ready?\", blocking=True)")
customcmd = CustomCommand(Name="CustomCommand", Manufacturer="UR", Code=initial_pop_up_command)

# ---- group: Pose Generation
number_slider = Slider(20, range=1..50)
camera_path = Curve(<curve referenced from the Rhino model>)
focal_path = Curve(<curve referenced from the Rhino model>)

# ----
series = Series(Start=0, Step=expr("1/x", number_slider), Count=expr("x+1", number_slider))
graph = GraphMapper(series, x0=0, x1=1, y0=0, y1=1, container_name="Bezier", cpx=[0, 0.6884058118, 0.3188405931, 1], cpy=[0, 0, 1, 1])

# ---- group: Pose Generation (continued)
graph_2 = GraphMapper(
    series,
    x0=0,
    x1=1,
    y0=0,
    y1=1,
    container_name="Bezier",
    cpx=[0, 0.6884058118, 1, 1],
    cpy=[0, 0.1739130616, 0.7536231875, 1])
eval = EvaluateCurve(Curve=reparameterize(camera_path), Parameter=graph)  # -> Point, Tangent, Angle
eval_2 = EvaluateCurve(Curve=reparameterize(focal_path), Parameter=graph_2)  # -> Point, Tangent, Angle
vec2pt = Vector2Pt(PointA=eval.Point, PointB=eval_2.Point, Unitize=False)  # -> Vector, Length
vdis = VectorDisplay(Anchor=eval.Point, Vector=vec2pt.Vector)
pl = PlaneNormal(Origin=eval.Point, ZAxis=vec2pt.Vector)
pflip = FlipPlane(Plane=pl, ReverseX=False, ReverseY=Toggle(True), SwapAxes=True)

# ---- group: Makes a pop up window with current pose number
# Full Pop Up Command: popup("Press 'Continue' to go to Pose", title="Ready?", blocking=True)
panel = Panel("popup(\"Press 'Continue' to go to Pose ")

# ---- group: Target Generation
list_2 = FlagFields({"Shoulder": 1, "Elbow": 2, "Wrist": 4}, selected="Shoulder")
list_3 = ValueList({"Joint", "Linear"}, selected="Linear")
pln = Plane(pflip)

# ---- group: Makes a pop up window with current pose number (continued)
number_of_poses = Integer(pln)
lng = ListLength(List=number_of_poses)
series_2 = Series(Start=1, Step=1, Count=expr("x-1", lng))
concat = Concatenate(FragmentA=panel, FragmentB=series_2)
concat_2 = Concatenate(FragmentA=concat, FragmentB=".\", title=\"Pose ")
concat_3 = Concatenate(FragmentA=concat_2, FragmentB=series_2)
concat_4 = Concatenate(FragmentA=concat_3, FragmentB="\", blocking=True)")

# ---- group: Target Generation (continued)
pop_up_commands = Text(concat_4)
customcmd_2 = CustomCommand(Name="CustomCommand", Manufacturer="UR", Code=pop_up_commands)
target = CreateTarget(Plane=pln, RobConf=list_2, Motion=list_3, Command=customcmd_2, IsCartesian=True)

# ---- group: .urp Program
robotsystem = RobotSystemParameter(loadrobot)
command = CommandParameter(customcmd)
targets = TargetParameter(target)
program = CreateProgram(Name="follow_path_target_advanced", RobotSystem=robotsystem, Targets=targets, InitCommands=command, StepSize=1)  # -> Program, Code, Duration, Warnings, Errors

# ---- group: Local Simulation
program_2 = ProgramParameter(program.Program)
sim = ProgramSimulation(Program=program_2, Time=Slider(1, range=0..1), Normalized=True)  # -> SystemMeshes, JointRotations, Plane, Index, Time, Program, Errors

# ---- group: Remote Control
program_3 = ProgramParameter(program.Program)
remote = RemoteConnection(Program=program_3, IP="192.168.125.124", Upload=Button(), Play=False, Pause=False)
panel_2 = Panel(remote)

# ---- group: Debugging
errors = Panel(program.Errors)
program_4 = Panel(program.Code)
warnings = Panel(program.Warnings)

# ---- group: Add a program call to the end of the .urp script
program_5 = ProgramParameter(program.Program)
code = Text(program.Code)
ins = InsertItems(List=code, Item="Program()", Indices=-1, Wrap=True)
custom = CustomCode(Program=program_5, Code=ins)

# ---- group: Save out .urp file
panel_3 = Panel("C:\Users\madel\Documents\robotics_in_animation\robotics_in_animation")
saveprog = SaveProgram(Program=custom, Folder=panel_3)
