# Grasshopper definition 06-110c.gh (Grasshopper 1.0.7)
# plug-ins: Robots

# ---- group: Pose Generation / Frame Count
fps = Slider(12, range=0..30)
seconds = Slider(0.31, range=0..10)
multiplication = Multiplication(A=seconds, B=fps)
total_frame_count = Integer(multiplication)
panel = Panel(total_frame_count)

seconds_2 = Slider(1.57, range=0..10)
fps_2 = Slider(12, range=0..30)
multiplication_2 = Multiplication(A=seconds_2, B=fps_2)
total_frame_count_2 = Integer(multiplication_2)
panel_2 = Panel(total_frame_count_2)

# ----
# tool center point (tcp)
pt = Point(Point(0, -35, 110))
weight = Panel("2.0")
mesh = Mesh(<mesh referenced from the Rhino model>)
pl = ConstructPlane(Origin=pt, XAxis=Vector(1, 0, 0), YAxis="0,0,1")
tool = CreateTool(Name="Camera", TCP=pl, Weight=weight, Mesh=mesh)  # -> Tool, TCP

# ---- group: Robot System
list = RobotsLibrary({"UR3e", "UR5e", "UR10e", "UR16e", "UR3", "UR5", "UR10"}, selected="UR5e", Type=0)
loadrobot = LoadRobotSystem(Name=list, Base=PlaneXY(0, 0, 0))

# ---- group: Make Initial Pop Up for Remote Safety
initial_pop_up_command = Panel("popup(\"Press 'Continue' to reset to Pose 0.\", title=\"Ready?\", blocking=True)")
customcmd = CustomCommand(Name="CustomCommand", Manufacturer="UR", Code=initial_pop_up_command)

# ----
tool_2 = ToolParameter(tool.Tool)
zone = ZoneParameter(Slider(5, range=0..100))

# ---- group: Pose Generation / Generate the Arc
number_slider = Slider(60, range=1..500)
rad = Radians(Degrees=Slider(147, range=-360..360))
rad_2 = Radians(Degrees=Slider(92, range=-360..360))
dom = ConstructDomain(DomainStart=rad_2, DomainEnd=rad)

# ----
subtraction = Subtraction(A=Slider(377, range=-500..500), B=number_slider)
pt_2 = ConstructPoint(XCoordinate=Slider(304, range=-500..500), YCoordinate=Slider(134, range=-500..500), ZCoordinate=subtraction)

# ---- group: Pose Generation / Generate the Arc (continued)
arc_center_point = Point(pt_2)
yz = YZPlane(Origin=arc_center_point)
arc = Arc(Plane=yz, Radius=number_slider, Angle=dom)  # -> Arc, Length

# ---- group: Pose Generation / Rotate Towards Subject
rot3d = Rotate3D(Geometry=arc.Arc, Angle=degrees(Slider(6, range=-360..360)), Center=arc_center_point, Axis=Vector(0, 1, 0))  # -> Geometry, Transform

# ----
rot3d_2 = Rotate3D(Geometry=rot3d.Geometry, Angle=degrees(Slider(8, range=-360..360)), Center=arc_center_point, Axis=Vector(0, 0, 1))  # -> Geometry, Transform
rot3d_3 = Rotate3D(Geometry=rot3d.Geometry, Angle=degrees(Slider(8, range=-360..360)), Center=arc_center_point, Axis=Vector(0, 0, 1))  # -> Geometry, Transform

# ---- group: Pose Generation
camera_path = Curve(<curve referenced from the Rhino model>)
focal_path = Curve(<curve referenced from the Rhino model>)
series = Series(Start=0, Step=expr("1/(x-0)", total_frame_count_2), Count=expr("x+1", total_frame_count_2))
graph = GraphMapper(
    series,
    x0=0,
    x1=1,
    y0=0,
    y1=1,
    container_name="Bezier",
    cpx=[0, 0.4836956561, 0.5024825335, 1],
    cpy=[0, 0, 0.9976081252, 1])
graph_2 = GraphMapper(series, x0=0, x1=1, y0=0, y1=1, container_name="Bezier", cpx=[0, 0.5065404773, 0.4960694313, 1], cpy=[0, 0, 1, 1])
eval = EvaluateCurve(Curve=reparameterize(camera_path), Parameter=graph)  # -> Point, Tangent, Angle
eval_2 = EvaluateCurve(Curve=reparameterize(focal_path), Parameter=graph_2)  # -> Point, Tangent, Angle
vec2pt = Vector2Pt(PointA=eval.Point, PointB=eval_2.Point, Unitize=False)  # -> Vector, Length
vdis = VectorDisplay(Anchor=eval.Point, Vector=vec2pt.Vector)
pl_2 = PlaneNormal(Origin=eval.Point, ZAxis=vec2pt.Vector)

# ---- group: Pose Generation / Sets the Horizon Line: -90 for underslung shots, +90 for reaching shots
yz_2 = YZPlane(Origin=Point(0, 0, 0))
prot = RotatePlane(Plane=yz_2, Angle=flatten(degrees(Slider(-88, range=-95..95))))
align = AlignPlanes(Planes=pl_2, Master=prot)

# ----
flip = FlipMatrix(Data=align)
item = ListItem(List=align, Index=0, Wrap=True)

# ---- group: Pose Generation (continued)
pflip = FlipPlane(Plane=align, ReverseX=False, ReverseY=Toggle(True), SwapAxes=True)

series_2 = Series(Start=0, Step=expr("1/(x-0)", total_frame_count), Count=expr("x+1", total_frame_count))
camera_path_2 = Curve(rot3d_2.Geometry)
graph_3 = GraphMapper(series_2, x0=0, x1=1, y0=0, y1=1, container_name="Bezier", cpx=[0, 0.7500964403, 0.375613004, 1], cpy=[0, 0, 1, 1])

# ----
panel_3 = Panel(graph_3)

# ---- group: Pose Generation / Reorient towards Set
pframe = PerpFrame(Curve=reparameterize(camera_path_2), Parameter=graph_3)
deplane = DeconstructPlane(Plane=pframe)  # -> Origin, XAxis, YAxis, ZAxis
rot3d_4 = Rotate3D(Geometry=pframe, Angle=expr("x*-1", 1.570796327), Center=deplane.Origin, Axis=deplane.XAxis)  # -> Geometry, Transform

# ----
pln = Plane(rot3d_4.Geometry)

# ---- group: Pose Generation (continued)
pflip_2 = FlipPlane(Plane=pln, ReverseX=False, ReverseY=Toggle(True), SwapAxes=True)

# ----
item_2 = ListItem(List=pflip_2, Index=0, Wrap=True)
deplane_2 = DeconstructPlane(Plane=item_2)  # -> Origin, XAxis, YAxis, ZAxis
pt_3 = Point(deplane_2.Origin)

# ---- group: Target Generation
list_2 = FlagFields({"Shoulder": 1, "Elbow": 2, "Wrist": 4}, selected=[])
list_3 = ValueList({"Joint", "Linear"}, selected="Linear")
pln_2 = Plane(pflip)

# ---- group: Makes a pop up window with current pose number
# Full Pop Up Command: popup("Press 'Continue' to go to Pose", title="Ready?", blocking=True)
number_of_poses = Integer(pln_2)
lng = ListLength(List=number_of_poses)
series_3 = Series(Start=1, Step=1, Count=expr("x-1", lng))
concat = Concatenate(FragmentA="popup(\"Press 'Continue' to go to Pose ", FragmentB=series_3)
concat_2 = Concatenate(FragmentA=concat, FragmentB=".\", title=\"Pose ")
concat_3 = Concatenate(FragmentA=concat_2, FragmentB=series_3)
concat_4 = Concatenate(FragmentA=concat_3, FragmentB="\", blocking=True)")

# ---- group: Target Generation (continued)
pop_up_commands = Text(concat_4)
customcmd_2 = CustomCommand(Name="CustomCommand", Manufacturer="UR", Code=pop_up_commands)
target = CreateTarget(Plane=pln_2, RobConf=list_2, Motion=list_3, Tool=tool_2, Command=customcmd_2, IsCartesian=True)

# ---- group: .urp Program
robotsystem = RobotSystemParameter(loadrobot)
command = CommandParameter(customcmd)
targets = TargetParameter(target)
program = CreateProgram(Name="shot_06_110c", RobotSystem=robotsystem, Targets=targets, InitCommands=command, StepSize=1)  # -> Program, Code, Duration, Warnings, Errors

# ---- group: Local Simulation
program_2 = ProgramParameter(program.Program)
sim = ProgramSimulation(Program=program_2, Time=Slider(1, range=0..1), Normalized=True)  # -> SystemMeshes, JointRotations, Plane, Index, Time, Program, Errors

# ---- group: Remote Control
send_button = Button()
program_3 = ProgramParameter(program.Program)
remote = RemoteConnection(Program=program_3, IP="10.0.0.10", Upload=send_button, Play=False, Pause=False)
panel_4 = Panel(remote)

# ---- group: Debugging
errors = Panel(program.Errors)
program_4 = Panel(program.Code)
warnings = Panel(program.Warnings)

# ---- group: Add a program call to the end of the .urp script
program_5 = ProgramParameter(program.Program)
code = Text(program.Code)
ins = InsertItems(List=code, Item="Program()", Indices=-1, Wrap=True)
custom = CustomCode(Program=program_5, Code=ins)

# ---- group: Save out .urp file
panel_5 = Panel("C:\Users\madel\Documents\robotics_in_animation\robotics_in_animation\on_set_files")
saveprog = SaveProgram(Program=custom, Folder=panel_5)
