# Grasshopper definition 0X-002.gh (Grasshopper 1.0.7)
# plug-ins: Robots

# ---- group: Pose Generation / Frame Count
seconds = Slider(3.11, range=0..10)
fps = Slider(12, range=0..30)
multiplication = Multiplication(A=seconds, B=fps)
total_frame_count = Integer(multiplication)
panel = Panel(total_frame_count)

# ----
# tool center point (tcp)
pt = Point(Point(0, -35, 110))
weight = Panel("2.0")
mesh = Mesh(<mesh referenced from the Rhino model>)
pl = ConstructPlane(Origin=pt, XAxis=Vector(1, 0, 0), YAxis="0,0,1")
tool = CreateTool(Name="Camera", TCP=pl, Weight=weight, Mesh=mesh)  # -> Tool, TCP

# ---- group: Robot System
list = RobotsLibrary({"UR3e", "UR5e", "UR10e", "UR16e", "UR3", "UR5", "UR10"}, selected="UR5e", Type=0)
loadrobot = LoadRobotSystem(Name=list, Base=PlaneXY(0, 0, 0))

# ---- group: Make Initial Pop Up for Remote Safety
initial_pop_up_command = Panel("popup(\"Press 'Continue' to reset to Pose 0.\", title=\"Ready?\", blocking=True)")
customcmd = CustomCommand(Name="CustomCommand", Manufacturer="UR", Code=initial_pop_up_command)

# ----
tool_2 = ToolParameter(tool.Tool)
zone = ZoneParameter(Slider(5, range=0..100))
send_button = Button()

# ---- group: Pose Generation
focal_point = Point(<point referenced from the Rhino model>)  # disabled
camera_path = Curve(<curve referenced from the Rhino model>)  # disabled
seconds_2 = Slider(1.15, range=0..10)  # disabled
fps_2 = Slider(2, range=0..30)  # disabled
multiplication_2 = Multiplication(A=seconds_2, B=fps_2)  # disabled
total_frame_count_2 = Integer(multiplication_2)  # disabled
divide = DivideCurve(Curve=camera_path, Count=expr("x-1", total_frame_count_2), Kinks=False)  # -> Points, Tangents, Parameters; disabled
vec2pt = Vector2Pt(PointA=divide.Points, PointB=focal_point, Unitize=True)  # -> Vector, Length; disabled
pl_2 = PlaneNormal(Origin=divide.Points, ZAxis=vec2pt.Vector)  # disabled
toggle = BooleanToggle(True)  # disabled

# ----
panel_2 = Panel(total_frame_count_2)  # disabled

# ---- group: Pose Generation / Visualizes LookAt Vectors
vec2pt_2 = Vector2Pt(PointA=divide.Points, PointB=focal_point, Unitize=False)  # -> Vector, Length; disabled
vdis = VectorDisplay(Anchor=divide.Points, Vector=vec2pt_2.Vector)  # disabled

# ---- group: Sets the Horizon Line: -90 for underslung shots, +90 for reaching shots
number_slider = Slider(-88, range=-95..95)  # disabled
yz = YZPlane(Origin=Point(0, 0, 0))  # disabled
prot = RotatePlane(Plane=yz, Angle=degrees(number_slider))  # disabled
align = AlignPlanes(Planes=pl_2, Master=prot)  # disabled

# ---- group: Pose Generation (continued)
pflip = FlipPlane(Plane=align, ReverseX=False, ReverseY=toggle, SwapAxes=True)  # disabled

camera_path_2 = Curve(<curve referenced from the Rhino model>)
focal_path = Curve(<curve referenced from the Rhino model>)
series = Series(Start=0, Step=expr("1/(x-0)", total_frame_count), Count=expr("x+1", total_frame_count))
graph = GraphMapper(
    series,
    x0=0,
    x1=1,
    y0=0,
    y1=1,
    A=1,
    B=0,
    container_name="Linear",
    Graph_x0=0.25,
    Graph_x1=0.75,
    Graph_y0=0.25,
    Graph_y1=0.75)
graph_2 = GraphMapper(
    series,
    x0=0,
    x1=1,
    y0=0,
    y1=1,
    A=1,
    B=0,
    container_name="Linear",
    Graph_x0=0.25,
    Graph_x1=0.75,
    Graph_y0=0.25,
    Graph_y1=0.75)
eval = EvaluateCurve(Curve=reparameterize(camera_path_2), Parameter=graph)  # -> Point, Tangent, Angle
eval_2 = EvaluateCurve(Curve=reparameterize(focal_path), Parameter=graph_2)  # -> Point, Tangent, Angle
vec2pt_3 = Vector2Pt(PointA=eval.Point, PointB=eval_2.Point, Unitize=False)  # -> Vector, Length
vdis_2 = VectorDisplay(Anchor=eval.Point, Vector=vec2pt_3.Vector)
pl_3 = PlaneNormal(Origin=eval.Point, ZAxis=vec2pt_3.Vector)

# ---- group: compensate for new camera orientation
item = ListItem(List=eval.Point, Index=0, Wrap=True)
rot3d = Rotate3D(Geometry=pl_3, Angle=degrees(Slider(12, range=-360..360)), Center=item, Axis=Vector(0, 0, 1))  # -> Geometry, Transform

# ---- group: Pose Generation / Sets the Horizon Line: -90 for underslung shots, +90 for reaching shots
yz_2 = YZPlane(Origin=Point(0, 0, 0))
prot_2 = RotatePlane(Plane=yz_2, Angle=degrees(Slider(-90.215, range=-100..95)))
align_2 = AlignPlanes(Planes=rot3d.Geometry, Master=prot_2)

# ---- group: Pose Generation (continued)
pflip_2 = FlipPlane(Plane=align_2, ReverseX=False, ReverseY=Toggle(True), SwapAxes=True)

# ---- group: Target Generation
list_2 = FlagFields({"Shoulder": 1, "Elbow": 2, "Wrist": 4}, selected=[])
list_3 = ValueList({"Joint", "Linear"}, selected="Linear")
pln = Plane(pflip_2)
target = CreateTarget(Plane=pln, RobConf=list_2, Motion=list_3, Tool=tool_2, Speed=Slider(10, range=0..100), Zone=zone, IsCartesian=True)

# ---- group: Makes a pop up window with current pose number
# Full Pop Up Command: popup("Press 'Continue' to go to Pose", title="Ready?", blocking=True)
number_of_poses = Integer(pln)
lng = ListLength(List=number_of_poses)
series_2 = Series(Start=1, Step=1, Count=expr("x-1", lng))
concat = Concatenate(FragmentA="popup(\"Press 'Continue' to go to Pose ", FragmentB=series_2)
concat_2 = Concatenate(FragmentA=concat, FragmentB=".\", title=\"Pose ")
concat_3 = Concatenate(FragmentA=concat_2, FragmentB=series_2)
concat_4 = Concatenate(FragmentA=concat_3, FragmentB="\", blocking=True)")

# ---- group: Target Generation (continued)
pop_up_commands = Text(concat_4)
customcmd_2 = CustomCommand(Name="CustomCommand", Manufacturer="UR", Code=pop_up_commands)

# ---- group: .urp Program
robotsystem = RobotSystemParameter(loadrobot)
command = CommandParameter(customcmd)
targets = TargetParameter(target)
program = CreateProgram(Name="shot_0X_002", RobotSystem=robotsystem, Targets=targets, InitCommands=command, StepSize=1)  # -> Program, Code, Duration, Warnings, Errors

# ---- group: Local Simulation
program_2 = ProgramParameter(program.Program)
sim = ProgramSimulation(Program=program_2, Time=Slider(1, range=0..1), Normalized=True)  # -> SystemMeshes, JointRotations, Plane, Index, Time, Program, Errors

# ---- group: Remote Control
send_button_2 = Button()
program_3 = ProgramParameter(program.Program)
remote = RemoteConnection(Program=program_3, IP="10.0.0.10", Upload=send_button_2, Play=False, Pause=send_button)
panel_3 = Panel(remote)

# ---- group: Debugging
errors = Panel(program.Errors)
program_4 = Panel(program.Code)
warnings = Panel(program.Warnings)

# ---- group: Add a program call to the end of the .urp script
program_5 = ProgramParameter(program.Program)
code = Text(program.Code)
ins = InsertItems(List=code, Item="Program()", Indices=-1, Wrap=True)
custom = CustomCode(Program=program_5, Code=ins)

# ---- group: Save out .urp file
panel_4 = Panel("C:\Users\madel\Documents\robotics_in_animation\robotics_in_animation\on_set_files")
saveprog = SaveProgram(Program=custom, Folder=panel_4)
