# Grasshopper definition follow_path.gh (Grasshopper 1.0.7)
# plug-ins: Robots

# ----
# tool center point (tcp)
pt = Point(Point(35, 0, 110))
weight = Panel("2.0")
mesh = Mesh(<mesh referenced from the Rhino model>)
pl = ConstructPlane(Origin=pt, XAxis=Vector(1, 0, 0), YAxis="0,0,1")
tool = CreateTool(Name="Camera", TCP=pl, Weight=weight, Mesh=mesh)  # -> Tool, TCP

# ---- group: Robot System
list = RobotsLibrary({"UR3e", "UR5e", "UR10e", "UR16e", "UR3", "UR5", "UR10"}, selected="UR5e", Type=0)
loadrobot = LoadRobotSystem(Name=list, Base=PlaneXY(0, 0, 0))

# ---- group: Pose Generation
focal_point = Point(<point referenced from the Rhino model>)
camera_path = Curve(<curve referenced from the Rhino model>)
divide = DivideCurve(Curve=camera_path, Count=10, Kinks=False)  # -> Points, Tangents, Parameters
vec2pt = Vector2Pt(PointA=divide.Points, PointB=focal_point, Unitize=True)  # -> Vector, Length
pl_2 = PlaneNormal(Origin=divide.Points, ZAxis=vec2pt.Vector)
pflip = FlipPlane(Plane=pl_2, ReverseX=False, ReverseY=Toggle(True), SwapAxes=True)

# ---- group: Make Initial Pop Up for Remote Safety
initial_pop_up_command = Panel("popup(\"Press 'Continue' to reset to Pose 0.\", title=\"Ready?\", blocking=True)")
customcmd = CustomCommand(Name="CustomCommand", Manufacturer="UR", Code=initial_pop_up_command)

# ----
tool_2 = ToolParameter(tool.Tool)

# ---- group: Makes a pop up window with current pose number
# Full Pop Up Command: popup("Press 'Continue' to go to Pose", title="Ready?", blocking=True)
panel = Panel("popup(\"Press 'Continue' to go to Pose ")

# ---- group: Target Generation
list_2 = FlagFields({"Shoulder": 1, "Elbow": 2, "Wrist": 4}, selected="Wrist")
list_3 = ValueList({"Joint", "Linear"}, selected="Linear")
pln = Plane(pflip)

# ---- group: Makes a pop up window with current pose number (continued)
number_of_poses = Integer(pln)
lng = ListLength(List=number_of_poses)
series = Series(Start=1, Step=1, Count=expr("x-1", lng))
concat = Concatenate(FragmentA=panel, FragmentB=series)
concat_2 = Concatenate(FragmentA=concat, FragmentB=".\", title=\"Pose ")
concat_3 = Concatenate(FragmentA=concat_2, FragmentB=series)
concat_4 = Concatenate(FragmentA=concat_3, FragmentB="\", blocking=True)")

# ---- group: Target Generation (continued)
pop_up_commands = Text(concat_4)
customcmd_2 = CustomCommand(Name="CustomCommand", Manufacturer="UR", Code=pop_up_commands)
target = CreateTarget(Plane=pln, RobConf=list_2, Motion=list_3, Tool=tool_2, Command=customcmd_2, IsCartesian=True)

# ---- group: .urp Program
robotsystem = RobotSystemParameter(loadrobot)
command = CommandParameter(customcmd)
targets = TargetParameter(target)
program = CreateProgram(Name="follow_path", RobotSystem=robotsystem, Targets=targets, InitCommands=command, StepSize=1)  # -> Program, Code, Duration, Warnings, Errors

# ---- group: Local Simulation
program_2 = ProgramParameter(program.Program)
sim = ProgramSimulation(Program=program_2, Time=Slider(0, range=0..1), Normalized=True)  # -> SystemMeshes, JointRotations, Plane, Index, Time, Program, Errors

# ---- group: Remote Control
send_button = Button()
program_3 = ProgramParameter(program.Program)
remote = RemoteConnection(Program=program_3, IP="10.0.0.10", Upload=send_button, Play=False, Pause=False)
panel_2 = Panel(remote)

# ---- group: Debugging
errors = Panel(program.Errors)
program_4 = Panel(program.Code)
warnings = Panel(program.Warnings)

# ---- group: Add a program call to the end of the .urp script
program_5 = ProgramParameter(program.Program)
code = Text(program.Code)
ins = InsertItems(List=code, Item="Program()", Indices=-1, Wrap=True)
custom = CustomCode(Program=program_5, Code=ins)

# ---- group: Save out .urp file
panel_3 = Panel("C:\Users\madel\Documents\robotics_in_animation\robotics_in_animation")
saveprog = SaveProgram(Program=custom, Folder=panel_3)
